# Dynamo graph wreath concept.dyn (Dynamo 2.0.0.2821)

code_block = CodeBlock()
# ---------- code_block.designscript (26 lines) ----------
radius = 11.0;
rows = 3;
led_radius = 0.479;
margin = 1.5;
strand_length = 50;

leds_per_row = Math.Floor(strand_length/rows);
total = leds_per_row * rows;
theta = 0..360..#leds_per_row;

outline = Circle.ByCenterPointRadius(Point.ByCoordinates(0,0,0), radius);

r1 = radius - margin - led_radius/2.0;
x1 = r1 * Math.Sin(theta);
y1 = r1 * Math.Cos(theta);
led1 = Circle.ByCenterPointRadius(Point.ByCoordinates(x1, y1, 0), led_radius);

r2 = r1 - margin - led_radius/2.0;
x2 = r2 * Math.Sin(theta - 180/leds_per_row);
y2 = r2 * Math.Cos(theta - 180/leds_per_row);
led2 = Circle.ByCenterPointRadius(Point.ByCoordinates(x2, y2, 0), led_radius);

r3 = r2 - margin - led_radius/2.0;
x3 = r3 * Math.Sin(theta);
y3 = r3 * Math.Cos(theta);
led3 = Circle.ByCenterPointRadius(Point.ByCoordinates(x3, y3, 0), led_radius);
# ----------------------------------------
